# Grasshopper definition CIRCLE.gh (Grasshopper 1.0.7)

construct_point = ConstructPoint(XCoordinate=0, YCoordinate=0, ZCoordinate=0)
get_number = GetNumber(AtLeast=1, AtMost=1, Maximum=1.797693135e+308, Minimum=-1.797693135e+308)
circle = Circle(Plane=construct_point, Radius=get_number)

# ---- group: RH_OUT:CRV
curve = Curve(circle)
